# Dynamo graph xml-to-objects.dyn "Try_schedule" (Dynamo 2.12.1.8246)
# packages: archi-lab.net 2024.217.1024, MEPover 2022.10.30

# group: Insert your LandXML data
file_path = Filename(".\CPH01-CIVIL-FIBRE_CIVIL FIBRE MODEL_S2 - Suitable for Information_E_0.xml")

# group: TRANSLATE TO DICTIONARIES
file_from_path = FileObject(path=file_path)
python_script = Python(IN[0]=file_from_path)  # CPython3
# ---------- python_script.python (88 lines) ----------
import sys
import clr
import re
# clr.AddReference('ProtoGeometry')
from Autodesk.DesignScript.Geometry import *

import xml.etree.ElementTree as ET

tree = ET.parse(IN[0].FullPath)
root = tree.getroot()

scale = 1

pipe_networks = root.find("PipeNetworks").findall("PipeNetwork")

#PLAN

# separate rectangle from circular pipes
# find the coordinate and other attributes
# render the pipes


def struct_to_coord(struct):
    elev = struct.find("Invert").attrib["elev"]
    coord = struct.find("Center").text
    coord = coord.split()
    
    coord = {
        "x": float(coord[0]),
        "y": float(coord[1]),
        "z": float(elev)
    }
    return coord
    
circ_pipes = []
rect_pipes = []

for pipe_network in pipe_networks:
    structs = pipe_network.find("Structs").findall("Struct")

    for pipe in pipe_network.find("Pipes").findall("Pipe"):
        attrs = pipe.attrib
        start_ref = attrs["refStart"]
        end_ref = attrs["refEnd"]
        
        start_struct = next((s for s in structs if s.attrib["name"] == start_ref))
        end_struct = next((s for s in structs if s.attrib["name"] == end_ref))
        start_coord = struct_to_coord(start_struct)
        end_coord = struct_to_coord(end_struct)
        
        id = pipe.attrib["name"]
        slope = float(pipe.attrib["slope"])
        length = float(pipe.attrib["length"])
        pipe_dict = ({
            "start": start_coord,
            "end": end_coord,
            "id": id,
            "slope": slope,
            "length": length,
        })
        if pipe.find("CircPipe") is not None:
            diameter = float(pipe.find("CircPipe").attrib["diameter"])
            pipe_dict["diameter"] = diameter
            material_circ = pipe.find("CircPipe").attrib["material"]
            pipe_dict["material"] = material_circ
            thickness_circ = float(pipe.find("CircPipe").attrib["thickness"])
            pipe_dict["thickness"] = thickness_circ
            circ_pipes.append(pipe_dict)
            
        elif pipe.find("RectPipe") is not None:
            rect_pipe = pipe.find("RectPipe")
            height = float(rect_pipe.attrib["height"])
            width = float(rect_pipe.attrib["width"])
            pipe_dict["height"] = height
            pipe_dict["width"] = width
            material_rect = rect_pipe.attrib["material"]
            pipe_dict["material"] = material_rect
            thickness_rect = float(rect_pipe.attrib["thickness"])
            pipe_dict["thickness"] = thickness_rect
            rect_pipes.append(pipe_dict)
  

#circ_pipes_as_list = []
#for key in circ_pipes[0].keys():
#    circ_pipes_as_lists[key] = [pipe[key] for pipe in circ_pipes])


OUT = circ_pipes, rect_pipes
# ----------------------------------------

# group: DIVIDE INPUTS
code_block = CodeBlock { 0; }
circPipes = List.GetItemAtIndex(list=python_script, index=code_block)
code_block_2 = CodeBlock { "start"; }
get_start_coordinates = archilab.Core.Dictionaries.TryGetValueAtKey(dictionary=circPipes, key=code_block_2)
code_block_3 = CodeBlock { "end"; }
get_end_coordinates = archilab.Core.Dictionaries.TryGetValueAtKey(dictionary=circPipes, key=code_block_3)
code_block_4 = CodeBlock { "diameter"; }
get_diameters = archilab.Core.Dictionaries.TryGetValueAtKey(dictionary=circPipes, key=code_block_4)
code_block_5 = CodeBlock { "id"; }
get_ids = archilab.Core.Dictionaries.TryGetValueAtKey(dictionary=circPipes, key=code_block_5)
code_block_6 = CodeBlock { "slope"; }
get_slopes = archilab.Core.Dictionaries.TryGetValueAtKey(dictionary=circPipes, key=code_block_6)
code_block_7 = CodeBlock { "material"; }
get_materials = archilab.Core.Dictionaries.TryGetValueAtKey(dictionary=circPipes, key=code_block_7)
code_block_8 = CodeBlock { "thickness"; }
get_pipe_thickness = archilab.Core.Dictionaries.TryGetValueAtKey(dictionary=circPipes, key=code_block_8)

# group: RECT PIPE MAKING PROCESS
code_block_9 = CodeBlock { "x"; }
tryGetValueAtKey = archilab.Core.Dictionaries.TryGetValueAtKey(dictionary=get_start_coordinates, key=code_block_9)
code_block_10 = CodeBlock { "y"; }
tryGetValueAtKey_2 = archilab.Core.Dictionaries.TryGetValueAtKey(dictionary=get_start_coordinates, key=code_block_10)
code_block_11 = CodeBlock { "z"; }
tryGetValueAtKey_3 = archilab.Core.Dictionaries.TryGetValueAtKey(dictionary=get_start_coordinates, key=code_block_11)
byCoordinates = Point.ByCoordinates(x=tryGetValueAtKey, y=tryGetValueAtKey_2, z=tryGetValueAtKey_3)
code_block_12 = CodeBlock { "x"; }
tryGetValueAtKey_4 = archilab.Core.Dictionaries.TryGetValueAtKey(dictionary=get_end_coordinates, key=code_block_12)
code_block_13 = CodeBlock { "y"; }
tryGetValueAtKey_5 = archilab.Core.Dictionaries.TryGetValueAtKey(dictionary=get_end_coordinates, key=code_block_13)
code_block_14 = CodeBlock { "z"; }
tryGetValueAtKey_6 = archilab.Core.Dictionaries.TryGetValueAtKey(dictionary=get_end_coordinates, key=code_block_14)
byCoordinates_2 = Point.ByCoordinates(x=tryGetValueAtKey_4, y=tryGetValueAtKey_5, z=tryGetValueAtKey_6)
byStartPointEndPoint = Line.ByStartPointEndPoint(startPoint=byCoordinates, endPoint=byCoordinates_2)
code_block_15 = CodeBlock { 1000; }
scale = Geometry.Scale(geometry=byStartPointEndPoint, xamount=code_block_15, yamount=code_block_15, zamount=code_block_15)
element_types = ElementTypes("PipeType")
all_elements_of_type = ElementsOfType(element_type=element_types)
code_block_16 = CodeBlock { 0; }
getItemAtIndex = List.GetItemAtIndex(list=all_elements_of_type, index=code_block_16)
multiplier = Custom[Multiplier](obj=getItemAtIndex, refernce=scale)
element_types_2 = ElementTypes("PipingSystemType")
all_elements_of_type_2 = ElementsOfType(element_type=element_types_2)
code_block_17 = CodeBlock { 2; }
getItemAtIndex_2 = List.GetItemAtIndex(list=all_elements_of_type_2, index=code_block_17)
multiplier_2 = Custom[Multiplier](obj=getItemAtIndex_2, refernce=scale)
levels = Levels("Level 1")
multiplier_3 = Custom[Multiplier](obj=levels, refernce=scale)
byLines = Custom[Pipe.ByLines](Lines=scale, PipeType=multiplier, SystemType=multiplier_2, level=multiplier_3, Diameter=get_diameters)  # package MEPover; Creates a pipe by Line, PipeType, SystemType, Level and Diameter
watch = Watch(get_ids)
watch_2 = Watch(get_slopes)
watch_3 = Watch(get_materials)
watch_4 = Watch(get_pipe_thickness)

# group: CIRC PIPE RESULT
watch_5 = Watch(byLines)

# group: DIVIDE INPUTS
code_block_18 = CodeBlock { 1; }
rectPipes = List.GetItemAtIndex(list=python_script, index=code_block_18)
code_block_19 = CodeBlock { "start"; }
get_start_coordinates_2 = archilab.Core.Dictionaries.TryGetValueAtKey(dictionary=rectPipes, key=code_block_19)
code_block_20 = CodeBlock { "end"; }
get_end_coordinates_2 = archilab.Core.Dictionaries.TryGetValueAtKey(dictionary=rectPipes, key=code_block_20)
code_block_21 = CodeBlock { "width"; }
get_widths = archilab.Core.Dictionaries.TryGetValueAtKey(dictionary=rectPipes, key=code_block_21)
code_block_22 = CodeBlock { "height"; }
get_heights = archilab.Core.Dictionaries.TryGetValueAtKey(dictionary=rectPipes, key=code_block_22)
code_block_23 = CodeBlock { "id"; }
get_ids_2 = archilab.Core.Dictionaries.TryGetValueAtKey(dictionary=rectPipes, key=code_block_23)
code_block_24 = CodeBlock { "thickness"; }
get_pipe_thickness_2 = archilab.Core.Dictionaries.TryGetValueAtKey(dictionary=rectPipes, key=code_block_24)
code_block_25 = CodeBlock { "material"; }
get_pipe_thickness_3 = archilab.Core.Dictionaries.TryGetValueAtKey(dictionary=rectPipes, key=code_block_25)
code_block_26 = CodeBlock { "slope"; }
get_slopes_2 = archilab.Core.Dictionaries.TryGetValueAtKey(dictionary=rectPipes, key=code_block_26)

# group: RECT PIPE MAKING PROCESS
code_block_27 = CodeBlock { "x"; }
tryGetValueAtKey_7 = archilab.Core.Dictionaries.TryGetValueAtKey(dictionary=get_start_coordinates_2, key=code_block_27)
code_block_28 = CodeBlock { "y"; }
tryGetValueAtKey_8 = archilab.Core.Dictionaries.TryGetValueAtKey(dictionary=get_start_coordinates_2, key=code_block_28)
code_block_29 = CodeBlock { "z"; }
tryGetValueAtKey_9 = archilab.Core.Dictionaries.TryGetValueAtKey(dictionary=get_start_coordinates_2, key=code_block_29)
byCoordinates_3 = Point.ByCoordinates(x=tryGetValueAtKey_7, y=tryGetValueAtKey_8, z=tryGetValueAtKey_9)
code_block_30 = CodeBlock { "x"; }
tryGetValueAtKey_10 = archilab.Core.Dictionaries.TryGetValueAtKey(dictionary=get_end_coordinates_2, key=code_block_30)
code_block_31 = CodeBlock { "y"; }
tryGetValueAtKey_11 = archilab.Core.Dictionaries.TryGetValueAtKey(dictionary=get_end_coordinates_2, key=code_block_31)
code_block_32 = CodeBlock { "z"; }
tryGetValueAtKey_12 = archilab.Core.Dictionaries.TryGetValueAtKey(dictionary=get_end_coordinates_2, key=code_block_32)
byCoordinates_4 = Point.ByCoordinates(x=tryGetValueAtKey_10, y=tryGetValueAtKey_11, z=tryGetValueAtKey_12)
byStartPointEndPoint_2 = Line.ByStartPointEndPoint(startPoint=byCoordinates_3, endPoint=byCoordinates_4)
code_block_33 = CodeBlock { 1000; }
scale_2 = Geometry.Scale(geometry=byStartPointEndPoint_2, xamount=code_block_33, yamount=code_block_33, zamount=code_block_33)
element_types_3 = ElementTypes("DuctType")
all_elements_of_type_3 = ElementsOfType(element_type=element_types_3)
code_block_34 = CodeBlock(x=all_elements_of_type_3) { x[0]; }
element_types_4 = ElementTypes("MechanicalSystemType")
all_elements_of_type_4 = ElementsOfType(element_type=element_types_4)
code_block_35 = CodeBlock(x=all_elements_of_type_4) { x[0]; }
levels_2 = Levels("Level 1")
byLines_2 = Custom[DuctRectangular.ByLines](Lines=scale_2, DuctType=code_block_34, MechanicalSystemType=code_block_35, level=levels_2, Width=get_widths, Height=get_heights)  # package MEPover; Create ducts by Lines, DuctType, MechanicalFittingType, Level, Width and Height
watch_6 = Watch(get_pipe_thickness_2)
watch_7 = Watch(get_pipe_thickness_3)
watch_8 = Watch(get_slopes_2)

# group: RECT PIPES RESULT
watch_9 = Watch(byLines_2)

element_types_5 = ElementTypes("PipeInsulationType")
all_elements_of_type_5 = ElementsOfType(element_type=element_types_5)
code_block_36 = CodeBlock { 0; }
getItemAtIndex_3 = List.GetItemAtIndex(list=all_elements_of_type_5, index=code_block_36)
multiplier_4 = Custom[Multiplier](obj=getItemAtIndex_3, refernce=byLines)
addInsulation = Custom[Element.AddInsulation](elements=byLines, InsulationType=multiplier_4, Thickness=get_pipe_thickness)  # package MEPover; Adds insulation to pipe or duct networks

# group: RESULT OF PIPE THICKNESS
watch_10 = Watch(addInsulation.Succeeded)

element_types_6 = ElementTypes("DuctInsulationType")
all_elements_of_type_6 = ElementsOfType(element_type=element_types_6)
code_block_37 = CodeBlock(x=all_elements_of_type_6) { x[0]; }
addInsulation_2 = Custom[Element.AddInsulation](elements=byLines_2, InsulationType=code_block_37, Thickness=get_pipe_thickness_2)

# group: RESULT OF PIPE THICKNESS
watch_11 = Watch(addInsulation_2.Succeeded)
